vi "Main.gvi"   [LabVIEW NXG 5.0.0]
# This template is for the Queued Message Handler design pattern.
# The Event Handling Loop generates messages based on user interface actions.
# The Message Handling Loop processes messages generated by the Event Handling Loop, or by other messages.  The messages are string values, so new messages can be added easily to the Message Cases case structure in the Message Handling Loop.  Each message cluster can also provide an optional value for Message Data, which is a variant that can be converted to whatever message-specific data is required.
panel controls:
  "Exit": bool
  "TEMP Button": bool
  "LUX Button": bool
  "VISA Resource Name": "VISA Instr" = "COM5"
  "Initialize VISA": bool
  "CMD Button": bool
  "Initialize AI": bool
  "PV Config Button": bool
  "Set PV Angle Button": bool
  "IR Thermometer Config Button": bool
  "Fans Button": bool
  "Brightness Config Button": bool
  "Optic Filter Config Button": bool
  "Reset CVM Button": bool
  "Stop": bool
  "PV Config Selector": string
  "PV Angle": i32
  "Fans Selector": string
  "Optic Filter Selector": string
  "IR Thermometer Selector": string
  "Brightness": i32
  "Prepare CVM Button": bool
  "write buffer": string = "@DO 34 0#"
  "stop_2": bool
  "Set Resistance Button": bool
  "Reset Resistance Button": bool
  "Resistance String": string
  "VAC Button": bool
panel indicators:
  "Display": string
  "TEMP_1": "TAG.gtype"
  "LUX_1": "TAG.gtype"
  "CMD": "TAG.gtype"
  "LUX_2": "TAG.gtype"
  "TEMP_2": "TAG.gtype"
  "Chart": waveform<f64>[]
  "Maсhine State": string
  "ANGLE Control": "TAG.gtype"
  "Thermometer Angle Control": "TAG.gtype"
  "Brightness Control": "TAG.gtype"
  "Image": "Vision IMAQImage"
  "Chart_2": waveform<f64>[]
  "Voltage Range": f64
  "error out": error
  "Variable: y": f64
  "Voltage coeff": f64
  "Current coeff": f64
  "V_real": f64
  "Current_real": f64
  "VAC Load Counter": i32
types:
  "TAG.gtype" = cluster{"Timestamp": timestamp, "DATA": string}
  "DataType.gtype" = enum{"Double", "I32", "String", "Boolean", "U64", "Timestamp"}
  "Tag.gtype" = cluster{"Path": string, "Datatype": "DataType.gtype", "Configuration": "Configuration.gtype"}
  "Client Handle.gtype" = u32
  "Configuration.gtype" = cluster{"Server URL": string, "Session": "Client Handle.gtype", "Raw Session Queue": Queue<"Client Handle.gtype">}
  T1 = cluster{"VISA Resource": "VISA Instr", "Physical Channel": "DAQmx Task", "tag": "Tag.gtype", "configuration": "Configuration.gtype"}
  "UI Data.gtype" = cluster{"Boolean <Replace Me>": bool, "String <Replace Me>": string, "Numeric <Replace Me>": f64}
  "ValueRange.gtype" = cluster{"maximum value": f64, "minimum value": f64}
uses:
  Message Queue::Create All Message Queues.gvi
  Message Queue::Dequeue Message.gvi
  Message Queue::Enqueue Message (Single).gvi
  NI::VISA::Configure Serial Port (Instr).gvi
  NI::VISA::Open (Instr).gvi
  NI::Skyline::Configuration::Open Configuration API Key.gvi
  NI::Skyline::TagHTTP::Open Tag.gvi
  NI::DAQmx::Internal::DAQmx Create Channel (AI-Voltage-Basic).gvi
  Queued Message Handler::Read_Write_VISA.gvi
  Queued Message Handler::PV_switch.gvi
  Queued Message Handler::CMD_Iteration.gvi
  NI::DAQmx::Internal::DAQmx Read (Analog 2D DBL NChan NSamp).gvi
  NI::Skyline::TagHTTP::Write Tag (String).gvi
  NI::DAQmx::Internal::DAQmx Read (Analog 1D Wfm NChan NSamp).gvi
  NI::G Core::Error::Display Error.gvi
  NI::VISA::Close (Instr).gvi
  NI::DAQmx::Internal::DAQmx Stop Task.gvi
  NI::Skyline::TagHTTP::Close Tag (Single).gvi
  NI::Skyline::Configuration::Close Configuration.gvi
  NI::G Core::Error::Build Error Cluster.gvi
  Support::Error Handler - Message Handling Loop.gvi
  Support::Error Handler - Event Handling Loop.gvi
  NI::Vision::IMAQdx::Initialize.gvi
  NI::Vision::IMAQdx::Configure Grab.gvi
  NI::Vision::Core::Basics::Create Image.gvi
  NI::Vision::IMAQdx::Grab.gvi
  NI::Vision::IMAQdx::Close.gvi
diagram:
  w1 = bool FALSE  # Stop Event
  Create User Event[EventName="Stop Event"](user event data type=w1) -> (error out=w2, user event out=w3)
  call "Create All Message Queues.gvi"(error in=w2) -> (message queues=w4, error out=w5)
  Property Node(instance in=w4) -> ("UI"=w6)
  w7 = T1 {"VISA Resource"="COM5", "Physical Channel"="", "tag"={"Path"="", "Datatype"="Double", "Configuration"={"Server URL"="", "Session"=0, "Raw Session Queue"=refnum}}, "configuration"={"Server URL"="", "Session"=0, "Raw Session Queue"=refnum}}
  s1 = "UI Data.gtype" {all zero or empty}  # shift register
  s2 = uninitialised  # shift register
  s3 = w7  # shift register
  while {
    call "Dequeue Message.gvi"(message queue in=w6, error in=w5) -> (message queue out=w8, message=w9, message data=w10, error out=w11)
    $"Maсhine State" <- w9
    # s1: Data
    # w3: Stop Event
    case (w9) ignore case {  # Message Cases
      frame "Initialize" {
        call "Enqueue Message (Single).gvi"(message queue in=w8, message="Initialize VISA", error in=w11) -> (error out=w17)
        call "Enqueue Message (Single).gvi"(message queue in=w8, message="Initialize AI", error in=w17) -> (error out=w18)
        call "Enqueue Message (Single).gvi"(message queue in=w8, message="Initialize SLC", error in=w18) -> (error out=w19)
        call "Enqueue Message (Single).gvi"(message queue in=w8, message="Wait For Event", error in=w19) -> (error out=w12)
        w13 = s1
        w14 = default
        w15 = s2
        w16 = s3
      }
      frame "Wait For Event" {
        call "Enqueue Message (Single).gvi"(message queue in=w8, message="Watchdog", error in=w11) -> (error out=w12)
        w13 = s1
        w14 = default
        w15 = s2
        w16 = s3
      }
      frame "Initialize VISA" {
        call "Configure Serial Port (Instr).gvi"(stop bits="1.0"(10), session in=$"VISA Resource Name", baud rate=115200, parity="None"(0), termination char=0xA, enable termination char=TRUE) -> (session out=w20, error out=w21)
        call "Open (Instr).gvi"(resource name=w20, error in=w21) -> (session out=w22, error out=w23)
        Property Node(instance in=s3, "VISA Resource"=w22) -> (instance out=w16)
        Wait(time to wait=2000)
        Merge Errors(w23, w11) -> (error out=w12)
        w13 = s1
        w14 = default
        w15 = s2
      }
      frame "Initialize SLC" {
        call "Open Configuration API Key.gvi"(server url="https://api.systemlinkcloud.com/", api key="zYUbuW0YNkg1G__lXfJiGVBNWME-HlVd2a5NUHp-IP") -> (configuration=w24, error out=w25)
        call "Open Tag.gvi"(path="PV_T", data type="String", error in=w25, configuration=w24) -> (tag=w26, error out=w27)
        Property Node(instance in=s3, "tag"=w26, "configuration"=w24) -> (instance out=w16)
        Wait(time to wait=2000)
        Merge Errors(w27, w11) -> (error out=w12)
        w13 = s1
        w14 = default
        w15 = s2
      }
      frame "Initialize AI" {
        call "DAQmx Create Channel (AI-Voltage-Basic).gvi"(physical channels="Dev1/ai0:1,Dev1/ai3,Dev1/ai7", units="Volts"(10348), measurement range="ValueRange.gtype" {"maximum value"=10, "minimum value"=0}, input terminal configuration="Default"(-1)) -> (task out=w28, error out=w29)
        Property Node(instance in=s3, "Physical Channel"=w28) -> (instance out=w16)
        Merge Errors(w29, w11) -> (error out=w12)
        w13 = s1
        w14 = default
        w15 = s2
      }
      frame "Send CMD" {
        Property Node(instance in=s3) -> ("VISA Resource"=w30, instance out=w16)
        call "Read_Write_VISA.gvi"(VISA_IN=w30, CMD=$"write buffer", ERROR_IN=w11) -> (TAG=w31, ERROR_OUT=w32)
        $CMD <- w31
        call "Enqueue Message (Single).gvi"(message queue in=w8, message="Wait For Event", error in=w11) -> (error out=w33)
        Merge Errors(w32, w33) -> (error out=w12)
        w13 = s1
        w14 = default
        w15 = $"write buffer"
      }
      frame "PV Config" {
        Variant To Data(error in (no error)=w11, type=string "", variant=w10) -> (data=w34, error out=w35)
        Property Node(instance in=s3) -> ("VISA Resource"=w36, instance out=w16)
        call "PV_switch.gvi"(VISA_IN=w36, CTRL="Disconnect", ERROR_IN=w35) -> (ERROR_OUT=w37)
        case (w34) {
          frame "Single", Default {
            # @DO 17 0#
            # @DO 18 1#
            # @DO 23 1#
            # @DO 24 1#
            # @DO 25 1#
            # @DO 26 0#
            # @DO 27 0#
            # @DO 28 0#
            # @DO 29 1#
            # @DO 30 1#
            # @DO 31 1#
            # @DO 32 1#
            # @DO 33 0#
            #
            # 03,08,2020
            # 19:51
            w39 = ["@DO 17 0#", "@DO 18 1#", "@DO 23 1#", "@DO 24 1#", "@DO 25 1#", "@DO 26 0#", "@DO 27 0#", "@DO 28 0#", "@DO 29 1#", "@DO 30 1#", "@DO 31 1#", "@DO 32 1#", "@DO 33 0#"]
            call "CMD_Iteration.gvi"(VISA_IN=w36, ARRAY_IN=w39, ERROR_IN=w37) -> (ERROR_OUT=w38)
          }
          frame "Parallel 2" {
            # @DO 17 1#
            # @DO 18 0#
            # @DO 23 1#
            # @DO 24 0#
            # @DO 25 1#
            # @DO 26 1#
            # @DO 27 1#
            # @DO 28 1#
            # @DO 29 1#
            # @DO 30 1#
            # @DO 31 1#
            # @DO 32 1#
            # @DO 33 1#
            #
            # 03.08.2020
            # 19.53
            w40 = ["@DO 17 1#", "@DO 18 0#", "@DO 23 1#", "@DO 24 0#", "@DO 25 1#", "@DO 26 1#", "@DO 27 1#", "@DO 28 1#", "@DO 29 1#", "@DO 30 1#", "@DO 31 1#", "@DO 32 1#", "@DO 33 1#"]
            call "CMD_Iteration.gvi"(VISA_IN=w36, ARRAY_IN=w40, ERROR_IN=w37) -> (ERROR_OUT=w38)
          }
          frame "Parallel 2 Diode" {
            # @DO 56 0#
            # @DO 57 0#
            #
            # 19.54
            # @DO 17 1#
            # @DO 18 0#
            # @DO 23 1#
            # @DO 24 0#
            # @DO 25 1#
            # @DO 26 1#
            # @DO 27 1#
            # @DO 28 1#
            # @DO 29 1#
            # @DO 30 1#
            # @DO 31 1#
            # @DO 32 1#
            # @DO 33 1#
            #
            # 03.08.2020
            # 19.54
            w41 = ["@DO 17 1#", "@DO 18 0#", "@DO 23 1#", "@DO 24 0#", "@DO 25 1#", "@DO 26 1#", "@DO 27 1#", "@DO 28 1#", "@DO 29 1#", "@DO 30 1#", "@DO 31 1#", "@DO 32 1#", "@DO 33 1#"]
            Insert Into Array(inArray=w41, new=["@DO 56 0#", "@DO 57 0#"]) -> w42
            call "CMD_Iteration.gvi"(VISA_IN=w36, ARRAY_IN=w42, ERROR_IN=w37) -> (ERROR_OUT=w38)
          }
          frame "Series 2" {
            # @DO 17 0#
            # @DO 18 1#
            # @DO 23 1#
            # @DO 24 0#
            # @DO 25 1#
            # @DO 26 1#
            # @DO 27 1#
            # @DO 28 1#
            # @DO 29 0#
            # @DO 30 1#
            # @DO 31 1#
            # @DO 32 0#
            # @DO 33 0#
            #
            # 03.08.2020
            # 19.55
            w43 = ["@DO 17 0#", "@DO 18 1#", "@DO 23 1#", "@DO 24 0#", "@DO 25 1#", "@DO 26 1#", "@DO 27 1#", "@DO 28 1#", "@DO 29 0#", "@DO 30 1#", "@DO 31 1#", "@DO 32 0#", "@DO 33 0#"]
            call "CMD_Iteration.gvi"(VISA_IN=w36, ARRAY_IN=w43, ERROR_IN=w37) -> (ERROR_OUT=w38)
          }
          frame "Series 2 Diode" {
            # @DO 17 0#
            # @DO 18 1#
            # @DO 23 1#
            # @DO 24 0#
            # @DO 25 1#
            # @DO 26 1#
            # @DO 27 1#
            # @DO 28 1#
            # @DO 29 0#
            # @DO 30 1#
            # @DO 31 1#
            # @DO 32 0#
            # @DO 33 0#
            #
            # 03.08.2020
            # 19.57
            w44 = ["@DO 17 0#", "@DO 18 1#", "@DO 23 1#", "@DO 24 0#", "@DO 25 1#", "@DO 26 1#", "@DO 27 1#", "@DO 28 1#", "@DO 29 0#", "@DO 30 1#", "@DO 31 1#", "@DO 32 0#", "@DO 33 0#"]
            # @DO 60 0#
            # @DO 61 0#
            #
            # 03.08.2020
            Insert Into Array(inArray=w44, new=["@DO 60 0#", "@DO 61 0#"]) -> w45
            call "CMD_Iteration.gvi"(VISA_IN=w36, ARRAY_IN=w45, ERROR_IN=w37) -> (ERROR_OUT=w38)
          }
          frame "Parallel 4" {
            # @DO 17 1#
            # @DO 18 1#
            # @DO 23 1#
            # @DO 24 1#
            # @DO 25 1#
            # @DO 26 1#
            # @DO 27 1#
            # @DO 28 1#
            # @DO 29 1#
            # @DO 30 1#
            # @DO 31 1#
            # @DO 32 1#
            # @DO 33 1#
            #
            # 03.08.2020
            # 19.59
            w46 = ["@DO 17 1#", "@DO 18 1#", "@DO 23 1#", "@DO 24 1#", "@DO 25 1#", "@DO 26 1#", "@DO 27 1#", "@DO 28 1#", "@DO 29 1#", "@DO 30 1#", "@DO 31 1#", "@DO 32 1#", "@DO 33 1#"]
            call "CMD_Iteration.gvi"(VISA_IN=w36, ARRAY_IN=w46, ERROR_IN=w37) -> (ERROR_OUT=w38)
          }
          frame "Parallel 4 Diode" {
            w47 = ["@DO 17 1#", "@DO 18 1#", "@DO 23 1#", "@DO 24 1#", "@DO 25 1#", "@DO 26 1#", "@DO 27 1#", "@DO 28 1#", "@DO 29 1#", "@DO 30 1#", "@DO 31 1#", "@DO 32 1#", "@DO 33 1#"]
            # @DO 17 1#
            # @DO 18 1#
            # @DO 23 1#
            # @DO 24 1#
            # @DO 25 1#
            # @DO 26 1#
            # @DO 27 1#
            # @DO 28 1#
            # @DO 29 1#
            # @DO 30 1#
            # @DO 31 1#
            # @DO 32 1#
            # @DO 33 1#
            # 03.08.2020
            # 20.00
            # @DO 54 0#
            # @DO 55 0#
            # @DO 56 0#
            # @DO 57 0#
            #
            # 03.08.2020
            # 20.00
            Insert Into Array(inArray=w47, new=["@DO 54 0#", "@DO 55 0#\n", "@DO 56 0#", "@DO 57 0#"]) -> w48
            call "CMD_Iteration.gvi"(VISA_IN=w36, ARRAY_IN=w48, ERROR_IN=w37) -> (ERROR_OUT=w38)
          }
          frame "Series 4" {
            # @DO 17 0#
            # @DO 18 1#
            # @DO 23 0#
            # @DO 24 1#
            # @DO 25 1#
            # @DO 26 0#
            # @DO 27 0#
            # @DO 28 0#
            # @DO 29 0#
            # @DO 30 0#
            # @DO 31 0#
            # @DO 32 0#
            # @DO 33 0#
            #
            # 03.08.2020
            # 20.02
            w49 = ["@DO 17 0#\n", "@DO 18 1#", "@DO 23 0#", "@DO 24 1#", "@DO 25 1#", "@DO 26 0#", "@DO 27 0#", "@DO 28 0#", "@DO 29 0#", "@DO 30 0#", "@DO 31 0#", "@DO 32 0#", "@DO 33 0#"]
            call "CMD_Iteration.gvi"(VISA_IN=w36, ARRAY_IN=w49, ERROR_IN=w37) -> (ERROR_OUT=w38)
          }
          frame "Series 4 Diode" {
            # @DO 17 0#
            # @DO 18 1#
            # @DO 23 0#
            # @DO 24 1#
            # @DO 25 1#
            # @DO 26 0#
            # @DO 27 0#
            # @DO 28 0#
            # @DO 29 0#
            # @DO 30 0#
            # @DO 31 0#
            # @DO 32 0#
            # @DO 33 0#
            #
            # 03.08.2020
            # 20.03
            w50 = ["@DO 17 0#\n", "@DO 18 1#", "@DO 23 0#", "@DO 24 1#", "@DO 25 1#", "@DO 26 0#", "@DO 27 0#", "@DO 28 0#", "@DO 29 0#", "@DO 30 0#", "@DO 31 0#", "@DO 32 0#", "@DO 33 0#"]
            # @DO 58 0#
            # @DO 59 0#
            # @DO 60 0#
            # @DO 61 0#
            #
            # 03.08.2020
            # 20.04
            Insert Into Array(inArray=w50, new=["@DO 58 0#", "@DO 59 0#", "@DO 60 0#", "@DO 61 0#"]) -> w51
            call "CMD_Iteration.gvi"(VISA_IN=w36, ARRAY_IN=w51, ERROR_IN=w37) -> (ERROR_OUT=w38)
          }
          frame "Parallel Of Series" {
            # @DO 17 1#
            # @DO 18 1#
            # @DO 23 1#
            # @DO 24 1#
            # @DO 25 1#
            # @DO 26 1#
            # @DO 27 0#
            # @DO 28 1#
            # @DO 29 0#
            # @DO 30 0#
            # @DO 31 1#
            # @DO 32 0#
            # @DO 33 1#
            #
            # 03.08.2020
            # 20.05
            w52 = ["@DO 17 1#", "@DO 18 1#", "@DO 23 1#", "@DO 24 1#", "@DO 25 1#", "@DO 26 1#", "@DO 27 0#", "@DO 28 1#", "@DO 29 0#", "@DO 30 0#", "@DO 31 1#", "@DO 32 0#", "@DO 33 1#"]
            call "CMD_Iteration.gvi"(VISA_IN=w36, ARRAY_IN=w52, ERROR_IN=w37) -> (ERROR_OUT=w38)
          }
          frame "Parallel Of Series Diode" {
            # @DO 17 1#
            # @DO 18 1#
            # @DO 23 1#
            # @DO 24 1#
            # @DO 25 1#
            # @DO 26 1#
            # @DO 27 0#
            # @DO 28 1#
            # @DO 29 0#
            # @DO 30 0#
            # @DO 31 1#
            # @DO 32 0#
            # @DO 33 1#
            #
            # 03.08.2020
            # 20.06
            # @DO 58 0#
            # @DO 59 0#
            # @DO 60 0#
            # @DO 61 0#
            #
            # 03.08.2020
            # 20.097
            w53 = ["@DO 17 1#", "@DO 18 1#", "@DO 23 1#", "@DO 24 1#", "@DO 25 1#", "@DO 26 1#", "@DO 27 0#", "@DO 28 1#", "@DO 29 0#", "@DO 30 0#", "@DO 31 1#", "@DO 32 0#", "@DO 33 1#"]
            # переделать добавление массива
            Insert Into Array(inArray=w53, new=["@DO 58 0#", "@DO 59 0#", "@DO 60 0#", "@DO 61 0#"]) -> w54
            call "CMD_Iteration.gvi"(VISA_IN=w36, ARRAY_IN=w54, ERROR_IN=w37) -> (ERROR_OUT=w38)
          }
          frame "Series Of Parallel" {
            # @DO 17 1#
            # @DO 18 0#
            # @DO 23 0#
            # @DO 24 0#
            # @DO 25 0#
            # @DO 26 1#
            # @DO 27 1#
            # @DO 28 1#
            # @DO 29 1#
            # @DO 30 1#
            # @DO 31 1#
            # @DO 32 1#
            # @DO 33 1#
            #
            # 03.08.2020
            # 20.07
            w55 = ["@DO 17 1#", "@DO 18 0#", "@DO 23 0#", "@DO 24 0#", "@DO 25 0#", "@DO 26 1#", "@DO 27 1#", "@DO 28 1#", "@DO 29 1#", "@DO 30 1#", "@DO 31 1#", "@DO 32 1#", "@DO 33 1#"]
            call "CMD_Iteration.gvi"(VISA_IN=w36, ARRAY_IN=w55, ERROR_IN=w37) -> (ERROR_OUT=w38)
          }
          frame "Series Of Parallel Diode" {
            # @DO 17 1#
            # @DO 18 0#
            # @DO 23 0#
            # @DO 24 0#
            # @DO 25 0#
            # @DO 26 1#
            # @DO 27 1#
            # @DO 28 1#
            # @DO 29 1#
            # @DO 30 1#
            # @DO 31 1#
            # @DO 32 1#
            # @DO 33 1#
            #
            # 03.08.2020
            # 20.08
            w56 = ["@DO 17 1#", "@DO 18 0#", "@DO 23 0#", "@DO 24 0#", "@DO 25 0#", "@DO 26 1#", "@DO 27 1#", "@DO 28 1#", "@DO 29 1#", "@DO 30 1#", "@DO 31 1#", "@DO 32 1#", "@DO 33 1#"]
            # @DO 54 0#
            # @DO 55 0#
            # @DO 56 0#
            # @DO 57 0#
            #
            # 20.09
            # 03.08.2020
            Insert Into Array(inArray=w56, new=["@DO 54 0#", "@DO 55 0#", "@DO 56 0#", "@DO 57 0#"]) -> w57
            call "CMD_Iteration.gvi"(VISA_IN=w36, ARRAY_IN=w57, ERROR_IN=w37) -> (ERROR_OUT=w38)
          }
        }
        call "PV_switch.gvi"(VISA_IN=w36, CTRL="Connect", ERROR_IN=w38) -> (ERROR_OUT=w12)
        w13 = s1
        w14 = default
        w15 = s2
      }
      frame "Reset CVM" {
        Property Node(instance in=s3) -> ("VISA Resource"=w58, instance out=w16)
        # VOLTAGE RANGE
        # @DO 51 0#
        # @DO 52 0#
        # @DO 53 0#
        call "CMD_Iteration.gvi"(VISA_IN=w58, ARRAY_IN=["@DO 51 1#", "@DO 52 1#", "@DO 53 1#"], ERROR_IN=w11) -> (ERROR_OUT=w59)
        # CURRENT RANGE
        # @DO 50 1#
        call "CMD_Iteration.gvi"(VISA_IN=w58, ARRAY_IN=["@DO 50 1#"], ERROR_IN=w59) -> (ERROR_OUT=w12)
        $"Voltage coeff" <- 0.25
        $"Current coeff" <- 1
        w13 = s1
        w14 = default
        w15 = s2
      }
      frame "VAC" {
        w60 = ["1", "2", "3", "10", "20", "40", "100", "200", "1000", "2000", "4000"]
        Array Size(array=w60) -> (size(s)=w61)
        Is Less Or Equal(x=$"VAC Load Counter", y=w61) -> w62
        Variant To Data(type=timestamp 1904-01-01T00:00:00Z, variant=w10) -> (data=w63)
        Get Current Time() -> (current time=w64)
        Timestamp Subtract(x=w64, y=w63) -> w65
        Is Greater Or Equal(x=w65, y=10) -> w66
        Logical And(w66, w62) -> w67
        Property Node(instance in=s3) -> ("VISA Resource"=w68, instance out=w16)
        # Здесь сделать всё, включая измерения
        #
        # Варианты решения кейса
        #
        # 1)Из ватчдога сюда,
        # Таймер на нахождение в этом кейсе-не более 5 сек. , по прошествию- обратно на ватчдог
        #
        # 2) постоянное переключение между ватчдогом и вах
        case (w67) {
          frame False, Default {
            w69 = w11
            w70 = w63
            w71 = $"VAC Load Counter"
          }
          frame True {
            Get Current Time() -> (current time=w70)
            Array Index(array=w60) -> (out0[$"VAC Load Counter"]=w72)
            # Disconnect ALL load
            w73 = ["@DO 42 1#", "@DO 34 1#", "@DO 35 1#", "@DO 36 1#", "@DO 37 1#", "@DO 38 1#", "@DO 39 1#", "@DO 40 1#", "@DO 41 1#", "@DO 43 1#", "@DO 44 1#", "@DO 45 1#", "@DO 46 1#", "@DO 47 1#", "@DO 48 1#", "@DO 49 1#"]
            call "CMD_Iteration.gvi"(VISA_IN=w68, ARRAY_IN=w73, ERROR_IN=w11) -> (ERROR_OUT=w74)
            s4 = w72  # shift register
            while {
              Match Pattern(regular expression=",", string=s4) -> (after substring=w75, before substring=w76)
              case (w76) {
                frame "1" {
                  call "Read_Write_VISA.gvi"(VISA_IN=w68, CMD="@DO 43 0#", ERROR_IN=w74) -> (ERROR_OUT=w77)
                }
                frame "2" {
                  call "Read_Write_VISA.gvi"(VISA_IN=w68, CMD="@DO 44 0#", ERROR_IN=w74) -> (ERROR_OUT=w77)
                }
                frame "3" {
                  call "Read_Write_VISA.gvi"(VISA_IN=w68, CMD="@DO 45 0#", ERROR_IN=w74) -> (ERROR_OUT=w77)
                }
                frame "5" {
                  call "Read_Write_VISA.gvi"(VISA_IN=w68, CMD="@DO 46 0#", ERROR_IN=w74) -> (ERROR_OUT=w77)
                }
                frame "10" {
                  call "Read_Write_VISA.gvi"(VISA_IN=w68, CMD="@DO 47 0#", ERROR_IN=w74) -> (ERROR_OUT=w77)
                }
                frame "20" {
                  call "Read_Write_VISA.gvi"(VISA_IN=w68, CMD="@DO 48 0#", ERROR_IN=w74) -> (ERROR_OUT=w77)
                }
                frame "40" {
                  call "Read_Write_VISA.gvi"(VISA_IN=w68, CMD="@DO 49 0#", ERROR_IN=w74) -> (ERROR_OUT=w77)
                }
                frame "50" {
                  call "Read_Write_VISA.gvi"(VISA_IN=w68, CMD="@DO 41 0#", ERROR_IN=w74) -> (ERROR_OUT=w77)
                }
                frame "100" {
                  call "Read_Write_VISA.gvi"(VISA_IN=w68, CMD="@DO 34 0#", ERROR_IN=w74) -> (ERROR_OUT=w77)
                }
                frame "200" {
                  call "Read_Write_VISA.gvi"(VISA_IN=w68, CMD="@DO 35 0#", ERROR_IN=w74) -> (ERROR_OUT=w77)
                }
                frame "400" {
                  call "Read_Write_VISA.gvi"(VISA_IN=w68, CMD="@DO 36 0#", ERROR_IN=w74) -> (ERROR_OUT=w77)
                }
                frame "500" {
                  call "Read_Write_VISA.gvi"(VISA_IN=w68, CMD="@DO 37 0#", ERROR_IN=w74) -> (ERROR_OUT=w77)
                }
                frame "1000" {
                  call "Read_Write_VISA.gvi"(VISA_IN=w68, CMD="@DO 38 0#", ERROR_IN=w74) -> (ERROR_OUT=w77)
                }
                frame "2000" {
                  call "Read_Write_VISA.gvi"(VISA_IN=w68, CMD="@DO 39 0#", ERROR_IN=w74) -> (ERROR_OUT=w77)
                }
                frame "4000", Default {
                  call "Read_Write_VISA.gvi"(VISA_IN=w68, CMD="@DO 40 0#", ERROR_IN=w74) -> (ERROR_OUT=w77)
                }
              }
              Is Empty String Or Path(string/path=w75) -> w78
              next s4 = w75
              stop if w78
            }
            # Connect Load
            call "Read_Write_VISA.gvi"(VISA_IN=w68, CMD="@DO 42 0#", ERROR_IN=w77) -> (ERROR_OUT=w69)
            Increment(x=$"VAC Load Counter") -> w71
          }
        }
        call "Enqueue Message (Single).gvi"(message queue in=w8, message="Watchdog", error in=w69) -> (error out=w79)
        case (w62) {
          frame False, Default {
            w12 = w79
          }
          frame True {
            call "Enqueue Message (Single).gvi"(message queue in=w8, message="VAC", message data=w70, error in=w79) -> (error out=w12)
          }
        }
        $"VAC Load Counter" <- w71
        w13 = s1
        w14 = default
        w15 = s2
      }
      frame "Prepare CVM" {
        Property Node(instance in=s3) -> ("VISA Resource"=w80, "Physical Channel"=w81, instance out=w16)
        call "DAQmx Read (Analog 2D DBL NChan NSamp).gvi"(task in=w81, error in=w11, number of samples per channel=1) -> (data=w82)
        Array Index(array=w82) -> (out0[2, 0]=w83)
        Multiply(w83, 4) -> w84
        C Code Node("x"=w84) -> ("y"=w85, Error Out=w86)
        ~~~
        if(x>-1 && x<=1)
          y = 0;
        if(x>1 && x<=10)
          y = 1;
        if(x>10 && x<=20)
          y = 2;
        if(x>20 && x<=30)
          y = 3;
        ~~~
        $"Voltage Range" <- w85
        # Voltage Range
        # Tip For Local Wiring Solution
        # Relay 1(50) 	DO 1- REP A x1
        # 		DO 0- AMP A x10
        #
        # Relay 2(51) 	DO 1-REP V x1
        # 		DO 0-DIV V x0.25
        # Relay 3(52) 	DO 1-REP V x1
        # 		DO 0-DIV V x0.5
        # Relay 4(53) 	DO 1-REP V x1
        # 		DO 0-AMP V x10
        case (w85) {
          frame 0, Default {
            call "CMD_Iteration.gvi"(VISA_IN=w80, ARRAY_IN=["@DO 51 1#\n", "@DO 52 1#", "@DO 53 0#"], ERROR_IN=w86) -> (ERROR_OUT=w87)
            w88 = 0.1
          }
          frame 1 {
            call "CMD_Iteration.gvi"(VISA_IN=w80, ARRAY_IN=["@DO 51 1#\n", "@DO 52 1#", "@DO 53 1#"], ERROR_IN=w86) -> (ERROR_OUT=w87)
            w88 = 1
          }
          frame 2 {
            call "CMD_Iteration.gvi"(VISA_IN=w80, ARRAY_IN=["@DO 51 1#\n", "@DO 52 0#", "@DO 53 1#"], ERROR_IN=w86) -> (ERROR_OUT=w87)
            w88 = 2
          }
          frame 3 {
            # Div x0.25 works with 2 relay
            call "CMD_Iteration.gvi"(VISA_IN=w80, ARRAY_IN=["@DO 51 0#\n", "@DO 52 0#", "@DO 53 1#"], ERROR_IN=w86) -> (ERROR_OUT=w87)
            w88 = 4
          }
        }
        $"Voltage coeff" <- w88
        Array Index(array=w82) -> (out0[6, 0]=w89)
        C Code Node("x"=w89) -> ("y"=w90)
        ~~~
        if(x>-1 && x<=0.6)
          y = 0;
        if(x>0.6 && x<=6)
          y = 1;
        ~~~
        # Current Range
        case (w90) {
          frame 0, Default {
            call "CMD_Iteration.gvi"(VISA_IN=w80, ARRAY_IN=["@DO 50 0#"], ERROR_IN=w87) -> (ERROR_OUT=w12)
            w91 = 0.1
          }
          frame 1 {
            call "CMD_Iteration.gvi"(VISA_IN=w80, ARRAY_IN=["@DO 50 1#"], ERROR_IN=w87) -> (ERROR_OUT=w12)
            w91 = 0.1
          }
        }
        $"Current coeff" <- w91
        $"Variable: y" <- w90
        w13 = s1
        w14 = default
        w15 = s2
      }
      frame "Fans Control" {
        Variant To Data(error in (no error)=w11, type=string "", variant=w10) -> (data=w92, error out=w93)
        case (w92) {
          frame "Turn All Off", Default {
            w94 = ["@DO 7 1#", "@DO 8 1#"]
          }
          frame "Turn All On" {
            w94 = ["@DO 7 0#", "@DO 8 0#"]
          }
          frame "Turn 1,2 On" {
            w94 = ["@DO 7 1#", "@DO 8 0#", ""]
          }
          frame "Turn 3,4 On" {
            w94 = ["@DO 8 1#", "@DO 7 0#"]
          }
        }
        Property Node(instance in=s3) -> ("VISA Resource"=w95, instance out=w16)
        call "CMD_Iteration.gvi"(VISA_IN=w95, ARRAY_IN=w94, ERROR_IN=w93) -> (ERROR_OUT=w12)
        w13 = s1
        w14 = default
        w15 = s2
      }
      frame "Optic Filter Config" {
        Variant To Data(error in (no error)=w11, type=string "", variant=w10) -> (data=w96, error out=w97)
        case (w96) {
          frame "None", Default {
            w98 = ["@SERV 3 90#", "@SERV 4 0#"]
          }
          frame "Filter 1" {
            w98 = ["@SERV 3 90#", "@SERV 4 0#", "@SERV 3 0#"]
          }
          frame "Filter 2" {
            w98 = ["@SERV 3 90#", "@SERV 4 0#", "@SERV 4 90#"]
          }
        }
        Property Node(instance in=s3) -> ("VISA Resource"=w99, instance out=w16)
        call "CMD_Iteration.gvi"(VISA_IN=w99, ARRAY_IN=w98, ERROR_IN=w97) -> (ERROR_OUT=w12)
        w13 = s1
        w14 = default
        w15 = s2
      }
      frame "Set PV Angle" {
        Variant To Data(error in (no error)=w11, type=u32 0, variant=w10) -> (data=w100, error out=w101)
        Property Node(instance in=s3) -> ("VISA Resource"=w102, instance out=w16)
        # Set angle limits for PV panels
        In Range And Coerce(lower limit=0, upper limit=180, x=w100) -> (coerced(x)=w103)
        Number To Decimal String(number=w103) -> (decimal integer string=w104)
        Concatenate Strings("@SERV 13 ", w104, " #") -> w105
        call "Read_Write_VISA.gvi"(VISA_IN=w102, CMD=w105, ERROR_IN=w101) -> (TAG=w106, ERROR_OUT=w12)
        $"ANGLE Control" <- w106
        w13 = s1
        w14 = default
        w15 = s2
      }
      frame "Brightness Config" {
        Variant To Data(error in (no error)=w11, type=u32 0, variant=w10) -> (data=w107, error out=w108)
        Property Node(instance in=s3) -> ("VISA Resource"=w109, instance out=w16)
        # Set brightness limits
        In Range And Coerce(lower limit=0, upper limit=100, x=w107) -> (coerced(x)=w110)
        Number To Decimal String(number=w110) -> (decimal integer string=w111)
        Concatenate Strings("@DIM 6 ", w111, " #") -> w112
        call "Read_Write_VISA.gvi"(VISA_IN=w109, CMD=w112, ERROR_IN=w108) -> (TAG=w113, ERROR_OUT=w12)
        $"Brightness Control" <- w113
        w13 = s1
        w14 = default
        w15 = s2
      }
      frame "IR Thermometer" {
        Variant To Data(error in (no error)=w11, type=string "", variant=w10) -> (data=w114, error out=w115)
        case (w114) {
          frame "None", Default {
            w116 = "@SERV 5 0#"
          }
          frame "Panel 1" {
            w116 = "@SERV 5 50#"
          }
          frame "Panel 2" {
            w116 = "@SERV 5 90#"
          }
          frame "Panel 3" {
            w116 = "@SERV 5 120#"
          }
          frame "Panel 4" {
            w116 = "@SERV 5 150#"
          }
        }
        Property Node(instance in=s3) -> ("VISA Resource"=w117, instance out=w16)
        call "Read_Write_VISA.gvi"(VISA_IN=w117, CMD=w116, ERROR_IN=w115) -> (TAG=w118, ERROR_OUT=w12)
        $"Thermometer Angle Control" <- w118
        w13 = s1
        w14 = default
        w15 = s2
      }
      frame "Get Temperature" {
        Property Node(instance in=s3) -> ("VISA Resource"=w119, instance out=w16)
        call "Read_Write_VISA.gvi"(VISA_IN=w119, CMD="@TEMP 12 0#", ERROR_IN=w11) -> (TAG=w120, ERROR_OUT=w121)
        $TEMP_1 <- w120
        call "Enqueue Message (Single).gvi"(message queue in=w8, message="Wait For Event", error in=w11) -> (error out=w122)
        Merge Errors(w121, w122) -> (error out=w12)
        w13 = s1
        w14 = default
        w15 = s2
      }
      frame "Get Brightness" {
        Property Node(instance in=s3) -> ("VISA Resource"=w123, instance out=w16)
        call "Read_Write_VISA.gvi"(VISA_IN=w123, CMD="@LUX 10 1#", ERROR_IN=w11) -> (TAG=w124, ERROR_OUT=w125)
        $LUX_1 <- w124
        call "Enqueue Message (Single).gvi"(message queue in=w8, message="Wait For Event", error in=w11) -> (error out=w126)
        Merge Errors(w125, w126) -> (error out=w12)
        w13 = s1
        w14 = default
        w15 = s2
      }
      frame "Set Resistance" {
        Property Node(instance in=s3) -> ("VISA Resource"=w127, instance out=w16)
        Variant To Data(error in (no error)=w11, type=string "", variant=w10) -> (data=w128, error out=w129)
        # Disconnect ALL load
        w130 = ["@DO 42 1#", "@DO 34 1#", "@DO 35 1#", "@DO 36 1#", "@DO 37 1#", "@DO 38 1#", "@DO 39 1#", "@DO 40 1#", "@DO 41 1#", "@DO 43 1#", "@DO 44 1#", "@DO 45 1#", "@DO 46 1#", "@DO 47 1#", "@DO 48 1#", "@DO 49 1#"]
        call "CMD_Iteration.gvi"(VISA_IN=w127, ARRAY_IN=w130, ERROR_IN=w129) -> (ERROR_OUT=w131)
        s5 = w128  # shift register
        while {
          Match Pattern(regular expression=",", string=s5) -> (after substring=w132, before substring=w133)
          case (w133) {
            frame "1" {
              call "Read_Write_VISA.gvi"(VISA_IN=w127, CMD="@DO 43 0#", ERROR_IN=w131) -> (ERROR_OUT=w134)
            }
            frame "2" {
              call "Read_Write_VISA.gvi"(VISA_IN=w127, CMD="@DO 44 0#", ERROR_IN=w131) -> (ERROR_OUT=w134)
            }
            frame "3" {
              call "Read_Write_VISA.gvi"(VISA_IN=w127, CMD="@DO 45 0#", ERROR_IN=w131) -> (ERROR_OUT=w134)
            }
            frame "5" {
              call "Read_Write_VISA.gvi"(VISA_IN=w127, CMD="@DO 46 0#", ERROR_IN=w131) -> (ERROR_OUT=w134)
            }
            frame "10" {
              call "Read_Write_VISA.gvi"(VISA_IN=w127, CMD="@DO 47 0#", ERROR_IN=w131) -> (ERROR_OUT=w134)
            }
            frame "20" {
              call "Read_Write_VISA.gvi"(VISA_IN=w127, CMD="@DO 48 0#", ERROR_IN=w131) -> (ERROR_OUT=w134)
            }
            frame "40" {
              call "Read_Write_VISA.gvi"(VISA_IN=w127, CMD="@DO 49 0#", ERROR_IN=w131) -> (ERROR_OUT=w134)
            }
            frame "50" {
              call "Read_Write_VISA.gvi"(VISA_IN=w127, CMD="@DO 41 0#", ERROR_IN=w131) -> (ERROR_OUT=w134)
            }
            frame "100" {
              call "Read_Write_VISA.gvi"(VISA_IN=w127, CMD="@DO 34 0#", ERROR_IN=w131) -> (ERROR_OUT=w134)
            }
            frame "200" {
              call "Read_Write_VISA.gvi"(VISA_IN=w127, CMD="@DO 35 0#", ERROR_IN=w131) -> (ERROR_OUT=w134)
            }
            frame "400" {
              call "Read_Write_VISA.gvi"(VISA_IN=w127, CMD="@DO 36 0#", ERROR_IN=w131) -> (ERROR_OUT=w134)
            }
            frame "500" {
              call "Read_Write_VISA.gvi"(VISA_IN=w127, CMD="@DO 37 0#", ERROR_IN=w131) -> (ERROR_OUT=w134)
            }
            frame "1000" {
              call "Read_Write_VISA.gvi"(VISA_IN=w127, CMD="@DO 38 0#", ERROR_IN=w131) -> (ERROR_OUT=w134)
            }
            frame "2000" {
              call "Read_Write_VISA.gvi"(VISA_IN=w127, CMD="@DO 39 0#", ERROR_IN=w131) -> (ERROR_OUT=w134)
            }
            frame "4000", Default {
              call "Read_Write_VISA.gvi"(VISA_IN=w127, CMD="@DO 40 0#", ERROR_IN=w131) -> (ERROR_OUT=w134)
            }
          }
          Is Empty String Or Path(string/path=w132) -> w135
          next s5 = w132
          stop if w135
        }
        # Connect Load
        call "Read_Write_VISA.gvi"(VISA_IN=w127, CMD="@DO 42 0#", ERROR_IN=w134) -> (ERROR_OUT=w12)
        w13 = s1
        w14 = default
        w15 = s2
      }
      frame "Reset Resistance" {
        Property Node(instance in=s3) -> ("VISA Resource"=w136, instance out=w16)
        # Сопротивление в начальное положение
        w137 = ["@DO 42 1#", "@DO 34 1#", "@DO 35 1#", "@DO 36 1#", "@DO 37 1#", "@DO 38 1#", "@DO 39 1#", "@DO 40 1#", "@DO 41 1#", "@DO 43 1#", "@DO 44 1#", "@DO 45 1#", "@DO 46 1#", "@DO 47 1#", "@DO 48 1#", "@DO 49 1#"]
        call "CMD_Iteration.gvi"(VISA_IN=w136, ARRAY_IN=w137, ERROR_IN=w11) -> (ERROR_OUT=w12)
        w13 = s1
        w14 = default
        w15 = s2
      }
      frame "Watchdog" {
        Property Node(instance in=s3) -> ("Physical Channel"=w138, "VISA Resource"=w139, "tag"=w140, instance out=w16)
        call "DAQmx Read (Analog 2D DBL NChan NSamp).gvi"(task in=w138, number of samples per channel=1) -> (data=w141)
        Array Index(array=w141) -> (out0[2, 0]=w142)
        Multiply(w142, 4) -> w143
        Multiply(w143, $"Voltage coeff") -> w144
        $V_real <- w144
        call "Read_Write_VISA.gvi"(VISA_IN=w139, CMD="@LUX 10 1#", ERROR_IN=w11) -> (OUTPUT=w145, TAG=w146, ERROR_OUT=w147)
        $LUX_2 <- w146
        call "Read_Write_VISA.gvi"(VISA_IN=w145, CMD="@TEMP 12 0#", ERROR_IN=w147) -> (TAG=w148, ERROR_OUT=w149)
        $TEMP_2 <- w148
        Array Index(array=w141) -> (out0[6, 0]=w150)
        Multiply(w150, $"Current coeff") -> w151
        $Current_real <- w151
        Property Node(instance in=w148) -> ("DATA"=w152, "Timestamp"=w153)
        call "Write Tag (String).gvi"(tag in=w140, value=w152, time stamp=w153, error in=w149) -> (error out=w154)
        call "DAQmx Read (Analog 1D Wfm NChan NSamp).gvi"(task in=w138, error in=w154, number of samples per channel=1) -> (error out=w155, data=w156)
        $Chart <- w156
        call "Enqueue Message (Single).gvi"(message queue in=w8, message="Wait For Event", error in=w155) -> (error out=w12)
        w13 = s1
        w14 = default
        w15 = s2
      }
      frame "Update Display" {
        w12 = w11
        w13 = s1
        w14 = default
        w15 = s2
        w16 = s3
      }
      frame "Error" {
        Variant To Data(error in (no error)=w11, type=no error, variant=w10) -> (data=w157, error out=w12)
        # #CodeRecommended - If you ever change the name of this "Error" message, you'll need to update the name in the Check Loop Error.vi as well.
        call "Display Error.gvi"(error in=w157)
        w13 = s1
        w14 = default
        w15 = s2
        w16 = s3
      }
      frame "Exit" {
        Property Node(instance in=s3) -> ("VISA Resource"=w158, "Physical Channel"=w159, "tag"=w160, "configuration"=w161)
        call "Close (Instr).gvi"(session in=w158)
        call "DAQmx Stop Task.gvi"(task in=w159)
        call "Close Tag (Single).gvi"(tag=w160)
        call "Close Configuration.gvi"(configuration=w161)
        Release Queue(error in=w11, queue=w8) -> (error out=w162)
        disable {
          frame Enabled {
            w163 = FALSE
            w14 = FALSE
          }
          frame Disabled {
            w163 = TRUE
            w14 = TRUE
          }
        }
        Generate User Event(event data=w163, user event=w3) -> (error out=w164)
        Merge Errors(w164, w162) -> (error out=w12)
        w13 = s1
        w15 = s2
        w16 = default
      }
      frame Default {
        w165 = "The invalid message string \"%s\" was received in the Message Handling Loop."
        Format Into String(formatString=w165, w9) -> w166
        call "Build Error Cluster.gvi"(code=1, description=w166) -> (error out=w12)
        w13 = s1
        w14 = default
        w15 = s2
        w16 = s3
      }
    }
    call "Error Handler - Message Handling Loop.gvi"(message queue in=w8, error in=w12) -> (dup error in=w167)
    next s1 = w13
    next s2 = w15
    next s3 = w16
    stop if w14
  }
  Register For Events("Stop Event"=w3) -> (event registration refnum out=w168)
  s6 = w168  # shift register
  while {
    event (dynamic events = s6) {
      on "TEMP Button" Value changed {
        call "Enqueue Message (Single).gvi"(message queue in=w6, message="Get Temperature") -> (message queue out=w171, error out=w170)
        w169 = default
      }
      on "LUX Button" Value changed {
        call "Enqueue Message (Single).gvi"(message queue in=w6, message="Get Brightness") -> (message queue out=w171, error out=w170)
        w169 = default
      }
      on "Exit" Value changed {
        call "Enqueue Message (Single).gvi"(priority message=TRUE, message queue in=w6, message="Exit") -> (message queue out=w171, error out=w170)
        w169 = default
      }
      on dynamic event 0 {
        $Display <- "\"Exit\" button pressed"
        disable {
          frame Enabled {
            w169 = FALSE
          }
          frame Disabled {
            w169 = TRUE
          }
        }
        w170 = default
        w171 = w6
      }
      on "Window" Close? {
        call "Enqueue Message (Single).gvi"(priority message=TRUE, message queue in=w6, message="Exit") -> (message queue out=w171)
        Event Filter("Discard?"=TRUE)
        w169 = default
        w170 = default
      }
      on "Initialize VISA" Value changed {
        call "Enqueue Message (Single).gvi"(message queue in=w6, message="Initialize VISA") -> (message queue out=w171, error out=w170)
        w169 = default
      }
      on "CMD Button" Value changed {
        call "Enqueue Message (Single).gvi"(message queue in=w6, message="Send CMD") -> (message queue out=w171, error out=w170)
        w169 = default
      }
      on "Reset CVM Button" Value changed {
        call "Enqueue Message (Single).gvi"(message queue in=w6, message="Reset CVM") -> (message queue out=w171, error out=w170)
        w169 = default
      }
      on "Initialize AI" Value changed {
        call "Enqueue Message (Single).gvi"(message queue in=w6, message="Initialize AI") -> (message queue out=w171, error out=w170)
        w169 = default
      }
      on "PV Config Button" Value changed {
        call "Enqueue Message (Single).gvi"(message queue in=w6, message="PV Config", message data=$"PV Config Selector") -> (message queue out=w171, error out=w170)
        w169 = default
      }
      on "Set PV Angle Button" Value changed {
        call "Enqueue Message (Single).gvi"(message queue in=w6, message="Set PV Angle", message data=$"PV Angle") -> (message queue out=w171, error out=w170)
        w169 = default
      }
      on "IR Thermometer Config Button" Value changed {
        call "Enqueue Message (Single).gvi"(message queue in=w6, message="IR Thermometer", message data=$"IR Thermometer Selector") -> (message queue out=w171, error out=w170)
        w169 = default
      }
      on "Fans Button" Value changed {
        call "Enqueue Message (Single).gvi"(message queue in=w6, message="Fans Control", message data=$"Fans Selector") -> (message queue out=w171, error out=w170)
        w169 = default
      }
      on "Brightness Config Button" Value changed {
        call "Enqueue Message (Single).gvi"(message queue in=w6, message="Brightness Config", message data=$Brightness) -> (message queue out=w171, error out=w170)
        w169 = default
      }
      on "Optic Filter Config Button" Value changed {
        call "Enqueue Message (Single).gvi"(message queue in=w6, message="Optic Filter Config", message data=$"Optic Filter Selector") -> (message queue out=w171, error out=w170)
        w169 = default
      }
      on "Prepare CVM Button" Value changed {
        call "Enqueue Message (Single).gvi"(message queue in=w6, message="Prepare CVM") -> (message queue out=w171, error out=w170)
        w169 = default
      }
      on "Set Resistance Button" Value changed {
        call "Enqueue Message (Single).gvi"(message queue in=w6, message="Set Resistance", message data=$"Resistance String") -> (message queue out=w171, error out=w170)
        w169 = default
      }
      on "Reset Resistance Button" Value changed {
        call "Enqueue Message (Single).gvi"(message queue in=w6, message="Reset Resistance") -> (message queue out=w171, error out=w170)
        w169 = default
      }
      on "VAC Button" Value changed {
        Get Current Time() -> (current time=w172)
        call "Enqueue Message (Single).gvi"(message queue in=w6, message="VAC", message data=w172) -> (message queue out=w171)
        $"VAC Load Counter" <- 0
        w169 = default
        w170 = default
      }
    }
    call "Error Handler - Event Handling Loop.gvi"(message queue in=w171, error in=w170) -> (dup error in=w173)
    stop if w169
  }
  Unregister For Events(error in=w173, event registration refnum=s6) -> (error out=w174)
  Merge Errors(w174, w167) -> (error out=w175)
  Destroy User Event(error in=w175, user event=w3)
  disable {
    frame Enabled { }
    frame Disabled { }
  }
  $"error out" <- w175
  disable {
    frame Enabled { }
    frame Disabled {
      call "Initialize.gvi"(device name="cam0") -> (session out=w176, error out=w177)
      call "Configure Grab.gvi"(session in=w176, error in=w177) -> (session out=w178, error out=w179)
      call "Create Image.gvi"(image name="image_1") -> (new image=w180)
      while {
        call "Grab.gvi"(session in=w178, error in=w179, image in=w180) -> (session out=w181, error out=w182, image out=w183)
        $Image <- w183
        stop if $Stop
      }
      call "Close.gvi"(session=w181, error in=w182)
    }
  }
  disable {
    frame Enabled { }
    frame Disabled {
      call "DAQmx Create Channel (AI-Voltage-Basic).gvi"(physical channels="Dev1/ai3,Dev1/ai1,Dev1/ai0,Dev1/ai7", units="Volts"(10348), measurement range="ValueRange.gtype" {"maximum value"=10, "minimum value"=0}, input terminal configuration="Default"(-1)) -> (task out=w184, error out=w185)
      while {
        call "DAQmx Read (Analog 1D Wfm NChan NSamp).gvi"(task in=w184, error in=w185, number of samples per channel=1) -> (data=w186)
        $Chart_2 <- w186
        Wait Until Next Multiple(multiple to wait=50)
        stop if $stop_2
      }
    }
  }
